# Dynamo custom node All Families Of Category.dyf (Dynamo 2.0.3.8810)
# category: Clockwork.Revit.Selection.Collectors.Query
# Gets all famiies of a given category in the model  (does *not *work for system families)

docOrRevitLinkInstance = Input(docOrRevitLinkInstance: var = null)  # Use only if you want to query a linked model
toggle = Input(toggle: bool = true)
python_script = Python(IN[0]=docOrRevitLinkInstance, IN[1]=toggle)
# ---------- python_script.python (17 lines) ----------
import System
import clr
clr.AddReference('RevitAPI')
from Autodesk.Revit.DB import *

clr.AddReference("RevitServices")
import RevitServices
from RevitServices.Persistence import DocumentManager

inputdoc = UnwrapElement(IN[0])
if not inputdoc: doc = DocumentManager.Instance.CurrentDBDocument
elif inputdoc.GetType().ToString() == "Autodesk.Revit.DB.RevitLinkInstance": doc = inputdoc.GetLinkDocument()
elif inputdoc.GetType().ToString() == "Autodesk.Revit.DB.Document": doc = inputdoc
else: doc = DocumentManager.Instance.CurrentDBDocument

collector = FilteredElementCollector(doc).OfClass(Family)
OUT =  collector.ToElements()
# ----------------------------------------
category = Input(category: var[]..[])  # Works with categories, BuiltInCategories and BuiltInCategories as strings
isOfCategory = Custom[Element.IsOfCategory](element=python_script, category=category)  # Checks whether an element is of a specified category
filterByBoolMask = List.FilterByBoolMask(list=python_script, mask=isOfCategory)
families = Output(filterByBoolMask.in)
