# Dynamo graph Revit.Elements.Element.Query.dyn (Dynamo 2.0.3.8810)

categories = Categories(index=166)  # graph input
categories_2 = Categories(index=604)  # graph input
create = List.Create(item0=categories, item1=categories_2)
all_elements_of_category = ElementsOfCategory(Category=create)
watch = Watch(all_elements_of_category)
allInstances = Custom[Element.AllInstances](element=watch)  # Retrieves all instances of a given element
watch_2 = Watch(allInstances)
levels = Levels(index=2)  # graph input
allInstancesAtLevel = Custom[Element.AllInstancesAtLevel](element=watch@L2, level=levels)  # Retrieves all instances of an element on a given level
watch_3 = Watch(allInstancesAtLevel)
element_types = ElementTypes(index=75)  # graph input
all_elements_of_type = ElementsOfType(element_type=element_types)
watch_4 = Watch(all_elements_of_type)
views = Views(index=20)  # graph input
# note: Only works for annotation elements
allViewDependentInstances = Custom[Element.AllViewDependentInstances](element=watch_4@L2, view=views)  # Retrieves all instances of a view-dependent element in a given view
watch_5 = Watch(allViewDependentInstances)
string = StringInput("OST_Rooms")
all_elements_of_category_2 = Custom[All Elements Of Category+](category=string)  # Gets all placed elements of a given category in the model.
watch_6 = Watch(all_elements_of_category_2)
# note: Only works for rooms, areas and zones
area = Custom[Element.Area](element=watch_6@L2)  # Returns the area property of a given element (if that element has such a property)
watch_7 = Watch(area)
string_2 = StringInput("""Extrusion
Blend
Sweep
Revolution
SweptBlend""")
string_3 = StringInput("\n")
split = String.Split(str=string_2, separater0=string_3)
byName = Custom[ElementType.ByName](name=split)  # Retrieves an element type by its name - to be used with the OOTB node "All Elements of Type".
all_elements_of_type_2 = ElementsOfType(element_type=byName)
flatten = List.Flatten(list=all_elements_of_type_2)
# note: Will only return results when run inside a parametric family
associatedFamilyParameters = Custom[Element.AssociatedFamilyParameters](element=flatten)  # Returns the associated family parameters of an element in a family (and the respective element parameters). PLEASE NOTE: This node will only work in a family document!
watch_8 = Watch(associatedFamilyParameters.elementParamaters)
watch_9 = Watch(associatedFamilyParameters.associatedFamilyParameters)
watch_10 = Watch(associatedFamilyParameters.elementParameterNames)
watch_11 = Watch(associatedFamilyParameters.associatedFamilyParameterNames)
number_slider = DoubleSlider(30, range=0..100 step 0.1)  # graph input
containsTransparentMaterials = Custom[Element.ContainsTransparentMaterials](element=watch@L2, minTransparencyPercentage=number_slider)  # Checks if a given element contains transparent materials.
watch_12 = Watch(containsTransparentMaterials)
elevationOfHostLevel = Custom[Element.ElevationOfHostLevel](element=watch@L2)  # Returns the elevation of the level a given element is associated with
watch_13 = Watch(elevationOfHostLevel)
string_4 = StringInput("KeyBaseEntryTable")
byName_2 = Custom[ElementType.ByName](name=string_4)
all_elements_of_type_3 = ElementsOfType(element_type=byName_2)
externalFileReferencePath = Custom[Element.ExternalFileReferencePath](element=all_elements_of_type_3)  # Returns the full path of an element's external file reference as as string
watch_14 = Watch(externalFileReferencePath)
element_types_2 = ElementTypes(index=144)
all_elements_of_type_4 = ElementsOfType(element_type=element_types_2)
firstItem = List.FirstItem(list=all_elements_of_type_4)
members = Custom[Group.Members](group=firstItem)  # Retrieves the members of a group
group = Custom[Element.Group](element=members)  # Retrieves the group an element belongs to (if any)
watch_15 = Watch(group)
host = Custom[Element.Host+](element=watch@L2)  # Gets an element's host. Unlike the OOTB node FamilyInstance.GetHost it not only works for family instances but also for elements like wall sweeps, foundations, railings, builing pads and topo subregions.
watch_16 = Watch(host)
ID = Custom[Element.ID+](element=watch@L2)  # Gets the ID of a given Revit elements. Unlike the OOTB Element.Id node, this node also works on mixed lists of Revit elements and categories.
watch_17 = Watch(ID)
boolean = BoolSelector(true)  # graph input
inserts = Custom[Element.Inserts](element=watch@L2, includeOpenings=boolean, includeShadows=boolean, includeEmbeddedWalls=boolean, includeSharedEmbeddedInserts=boolean)  # Gets all the objects inserted into a given element.
watch_18 = Watch(inserts)
isRelatedToMass = Custom[Element.IsRelatedToMass](element=watch@L2)  # Returns true if an object (wall, roof, floor or curtain system) has been modelled by face and the underlying mass still exists in the project.
watch_19 = Watch(isRelatedToMass)
level = Custom[Element.Level](element=watch@L2)  # Gets an element's level
watch_20 = Watch(level)
location = Custom[Element.Location](element=watch@L2)  # Returns the location of an element as point, curve or curve loop, along with some booleans to help filtering the results. Unlike the OOTB Element.GetLocation node, it also retunrs sketch lines of sketch-based elements like floor slabs as well as the element's rotation property.
watch_21 = Watch(location.points)
watch_22 = Watch(location.isPoint)
watch_23 = Watch(location.curves)
watch_24 = Watch(location.isCurve)
watch_25 = Watch(location.hasLocation)
watch_26 = Watch(location.curveEndpoints)
boolean_2 = BoolSelector(false)  # graph input
materials = Custom[Element.Materials](element=watch@L2, returnPaintMaterials=boolean_2)  # Retrieves all materials from a given element. Unlike the OOTB node Element.GetMaterials, it also retrieves QTO information.
watch_27 = Watch(materials.materials)
watch_28 = Watch(materials.hasMaterial)
watch_29 = Watch(materials.materialVolumes)
watch_30 = Watch(materials.materialAreas)
name = Custom[Element.Name+](element=watch@L2)  # Gets an element's name. Unlike the OOTB node, this node should work for all Revit elements that have names and will also return the localized names of system parameters, parameter groups, display unit types, parameter types, unit symbol types and unit types.
watch_31 = Watch(name)
# note: Only works with annotation elements
ownerView = Custom[Element.OwnerView](element=watch_4@L2)  # Gets the owner view of a given Revit element (if possible)
watch_32 = Watch(ownerView)
boolean_3 = BoolSelector(true)
panels = Custom[Element.Panels](hostElement=watch@L2, organizeInRows=boolean_3)  # Retrieves the panels nested in a curtain wall, curtain system or glazed roof. Differences to OOTB node CurtainPanel.ByElement: - Returns embedded walls - Panels of curtain systems and glazed roofs are returned in a nested list, with one sublist for each face of the curtain system. PLEASE NOTE: Will not work for glazed roofs created by RoofByFace method.
watch_33 = Watch(panels)
string_5 = StringInput("Width")  # graph input
parameterExists = Custom[Element.ParameterExists](param=string_5, element=watch@L2)  # Checks if an element contains a parameter of a given name
watch_34 = Watch(parameterExists)
phases = Custom[Element.Phases](element=watch@L2)  # Gets the created and demolished phases of an element
watch_35 = Watch(phases.Created)
watch_36 = Watch(phases.Demolished)
elementType = Custom[Element.ElementType+](element=watch@L2)  # Gets the family type of a given element (if applicable). Unlike the OOTB node, it also works for elements in linked models.
watch_37 = Watch(elementType)
workset = Custom[Element.Workset](element=watch@L2)  # Retrieves the workset of a given element
watch_38 = Watch(workset)
watch_39 = Watch(location.hasRotation)
watch_40 = Watch(location.angle)
detail_level = DetailLevel(index=2)  # graph input
boolean_4 = BoolSelector(false)  # graph input
boolean_5 = BoolSelector(false)  # graph input
geometry = Custom[Element.Geometry+](element=watch@L2, detailLevel=detail_level, includeInvisibleObjects=boolean_4, returnGeometryWithoutInserts=boolean_5)  # Returns Dynamo AND native Revit geometry of a given element
watch_41 = Watch(geometry.dynamoGeometry)
watch_42 = Watch(geometry.revitGeometry)
category = Custom[Element.Category+](element=watch@L2)  # Returns the category of a given element. Unlike the OOTB node Element.GetCategory, it will work for subcategories, families, family documents, schedules, subcategories and graphics styles as well.
watch_43 = Watch(category.category)
watch_44 = Watch(geometry.subCategory)
watch_45 = Watch(location.hasMulipleCurves)
watch_46 = Watch(location.mulipleCurves)
string_6 = StringInput("OST_Stairs")
all_elements_of_category_3 = Custom[All Elements Of Category+](category=string_6)
all_elements_of_category_4 = ElementsOfCategory(Category=all_elements_of_category_3)
watch_47 = Watch(all_elements_of_category_4)
subComponents = Custom[Element.SubComponents](element=watch_47@L2)  # Retrieves all subcomponents of a given family instance
watch_48 = Watch(subComponents)
superComponent = Custom[Element.SuperComponent](element=watch_48@@L2)  # Retrieves the supercomponent of a given family instance, hand rail, top rail, stair component or beam in a beam system.
watch_49 = Watch(superComponent)
curtainGridLines = Custom[Element.CurtainGridLines](hostElement=watch@L2)  # Retrieves the grid lines of curtain walls, curtain systems or glazed roofs.
watch_50 = Watch(curtainGridLines.uGridLines)
watch_51 = Watch(curtainGridLines.vGridLines)
watch_52 = Watch(category.builtInCategory)
isOfCategory = Custom[Element.IsOfCategory](element=watch@L2, category=categories_2)  # Checks whether an element is of a specified category
watch_53 = Watch(isOfCategory)
dependentElements = Custom[Element.DependentElements](element=watch@L2)  # Returns all elements that, from a logical point of view, are the children of this element.
watch_54 = Watch(dependentElements)
