# Dynamo graph Revit.Elements.RoomTag.dyn (Dynamo 2.12.1.8246)
# packages: Clockwork for Dynamo 2.x 2.3.0

string = StringInput("OST_RoomTags")
byName = Category.ByName(name=string)
all_elements_of_category = ElementsOfCategory(Category=byName)

# group: RoomTag.Room
watch = Watch(all_elements_of_category)
room = Custom[RoomTag.Room](roomTag=watch)  # package Clockwork for Dynamo 2.x; Returns the room of a given room tag
watch_2 = Watch(room)
